# Grasshopper definition SampleDefinition_Modified.ghx (Grasshopper 1.0.7)
# plug-ins: RhinoCommon, GhPython
# Sample Grasshopper Definition

height = Slider(Digits=2, Max=50, Min=0, Value=45)
baseradius = Slider(Digits=2, Max=20, Min=1, Value=5)
turns = Slider(Digits=2, Max=10, Min=1, Value=3)
# Spiral Tower: Spiral Tower Definition
# This definition creates a spiral tower using a Python script to generate a spiral polyline, which is then used to create a pipe/tower structure.
segments = Slider(Digits=0, Max=200, Min=10, Value=100)
spiral = GhPythonScript(height=<missing>, base_radius=<missing>, turns=<missing>, segments=<missing>)  # -> out, a
# ---------- spiral: Python ----------
import math
import Rhino.Geometry as rg

# Generate spiral polyline points
points = []
for i in range(int(segments) + 1):
    t = float(i) / float(segments) * turns * 2 * math.pi
    radius = base_radius + (height / turns) * (t / (2 * math.pi)) * 0.1
    x = radius * math.cos(t)
    y = radius * math.sin(t)
    z = (float(i) / float(segments)) * height
    points.append(rg.Point3d(x, y, z))

# Create polyline
spiral = rg.Polyline(points)
spiral_polyline = spiral.ToPolylineCurve()

a = spiral_polyline
# ---------- end spiral ----------
pipe = Pipe(Curve=spiral.a, Radius=<missing>)
piperadius = Slider(Digits=2, Max=2, Min=0.1, Value=0.5)
